# Grasshopper definition capsid_fitting.gh (Grasshopper 1.0.8)
# plug-ins: NGon, Human, Kangaroo Components, Kangaroo2 Components

# Parameter setting
pdb = Panel("""1vb4
2BUK
6s44
5zju
3r0r
1stm
7odw
4v7g
4v4m
1m1c""")

# ---- group: Junction point (Z=0)
# 2axis{0.001,0}
# five axis{1/phi=0.618034,0}
# 3axis{0,(phi-1)/phi=0.381966}
# Generic point: {0.170,-0.100}
座標x = Slider(0.269, range=-1..1)
座標y = Slider(0.005, range=-1..1)

# ---- group: Left(rotate,0)⇔Right(mirror,1)
rotate_mirror = Slider(1, range=0..1)

# ----
pdb_id = Slider(5, range=0..9)
galapagos = Galapagos(fitness=item_5, gene=[座標x, 座標y, rotate_mirror])
num = Number(座標x)
num_2 = Number(座標y)

# ---- group: Axis
phi = GoldenRatio(Factor=1)
one_over_x = OneOverX(Value=phi)
# Get each axis
panel = Panel("1")
panel_2 = Panel("1")

# ---- group: Junction point (Z=1)
vec = VectorXYZ(XComponent=num, YComponent=num_2, ZComponent="1")  # -> Vector, Length
pt = Point(vec.Vector)

# ---- group: Axis / 3
vec_2 = VectorXYZ(XComponent=0, YComponent=one_over_x, ZComponent=phi)  # -> Vector, Length
unit = UnitVector(Vector=vec_2.Vector)

# ---- group: junction point(Z=1)
expression = Expression(x=num, y=num_2, Expression="{x,-y,1}")

# ---- group: PDB_ID
int = Integer(pdb_id)

# ---- group: Axis / 2
vec_3 = VectorXYZ(XComponent=0, YComponent=0, ZComponent=panel)  # -> Vector, Length

# ---- group: Axis / 5
vec_4 = VectorXYZ(XComponent=panel_2, YComponent=0, ZComponent=phi)  # -> Vector, Length

# ---- group: Axis / 3-symmetric
vec_5 = Vector(unit)

# ---- group: Axis / 2-symmetric
vec_6 = Vector(vec_3.Vector)

# ---- group: 1stm
geo = Geometry([Point(0.07877431223, -0.2117491115, 0.8156218552), Point(0.08121259972, -0.1748810295, 0.8569405463), Point(0.0489567001, -0.1311681164, 0.844998813), Point(0.07408868747, -0.0831074135, 0.8571021196), Point(0.03866007641, -0.04440327165, 0.8764468463), Point(0.03920355013, 0.01039944305, 0.8660180262)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])

# ---- group: 4v4m
geo_2 = Geometry([Point(0.1842125423, 0.05106830127, 0.5663675085), Point(0.2177393041, 0.07627272371, 0.5941438108), Point(0.1794776456, 0.09634657561, 0.6197175288), Point(0.1604984912, 0.05050116879, 0.6274463575), Point(0.2060801155, 0.03526772665, 0.6419543976), Point(0.2179503302, 0.07345025045, 0.6723949036)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])

# ---- group: 6s44
geo_3 = Geometry([Point(0.1965300243, -0.006834986442, 0.7328624352), Point(0.234460747, 0.01460892052, 0.7621631245), Point(0.2238285459, 0.009348052164, 0.8137914363), Point(0.2067203677, 0.05675109955, 0.8284832051), Point(0.2030060014, 0.07450825624, 0.8775984511), Point(0.182501042, 0.1202129131, 0.8931463193)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])

# ---- group: Axis / 5-symmetric
vec_7 = Vector(vec_4.Vector)

# ---- group: 2buk
geo_4 = Geometry([Point(0.1856590694, 0.05527154945, 0.5621409409), Point(0.2143275906, 0.07997903017, 0.5952280486), Point(0.1761421138, 0.09835930418, 0.6210728578), Point(0.1576964761, 0.05486629448, 0.6358842735), Point(0.2010456857, 0.03299559858, 0.6459110659), Point(0.2120790792, 0.07016140159, 0.6765927893)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])

# ---- group: 4v7g
geo_5 = Geometry()

# ---- group: 3r0r
geo_6 = Geometry([Point(-0.01503792378, -0.1354036603, 0.78577516), Point(-0.02212046168, -0.09118767547, 0.8030450808), Point(-0.02942744621, -0.1072231398, 0.8469493342), Point(0.0130677812, -0.128495692, 0.848832192), Point(0.03574935944, -0.08964148762, 0.8331708054), Point(0.05725882754, -0.07512727263, 0.8726734111)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])

# ---- group: 1vb4
geo_7 = Geometry([Point(0.07566794236, -0.1019092751, 0.8257870328), Point(0.07778680773, -0.05059470208, 0.8263982439), Point(0.04145369953, -0.02400022512, 0.8512541647), Point(0.04203774575, 0.02448919405, 0.8337599429), Point(0.02186777727, 0.06260160587, 0.8617805792), Point(0.01809185052, 0.1136445295, 0.8546497823)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])

# ---- group: 5jzu
geo_8 = Geometry([Point(0.05155942509, -0.08170795113, 0.8567948726), Point(0.06190596358, -0.03381189374, 0.8570052687), Point(0.03841585585, 0.001547030277, 0.8757552757), Point(0.04845298829, 0.04580447245, 0.8629582412), Point(0.03482674561, 0.07878715797, 0.8928716187), Point(0.04172031252, 0.1226856891, 0.9092948921)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])

# ---- group: 7odw
geo_9 = Geometry([Point(0.359230919, 0.1077183663, 0.8121651375), Point(0.3774185628, 0.1283516591, 0.8380590716), Point(0.3456750353, 0.1273833817, 0.8588620625), Point(0.3463438455, 0.08917136187, 0.8600100203), Point(0.3087307601, 0.08882198343, 0.8633540711), Point(0.3039392843, 0.05398396116, 0.8492791108)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])

# ---- group: 1m1c
geo_10 = Geometry([Point(0.004618045637, 0.2674998807, 0.9411235746), Point(-0.01570355686, 0.2649349114, 0.936846791), Point(-0.01150933662, 0.2573390795, 0.917851707), Point(0.0005834479589, 0.2436555736, 0.928056542), Point(-0.01291841849, 0.2366486938, 0.9424776142), Point(-0.02753213859, 0.2335773357, 0.9277428011)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])

# ---- group: projection to sphere
unit_2 = UnitVector(Vector=vec_5)
unit_3 = UnitVector(Vector=vec_7)
unit_4 = UnitVector(Vector=vec_6)
unit_5 = UnitVector(Vector=pt)

# ---- group: copy around 2-fold axis on sphere
pi = Pi(Factor=1)
rotate = Rotate(Geometry=unit_5, Angle=pi, Plane=vec_6)  # -> Geometry, Transform

# ---- group: copy around 3-fold axis on sphere
pl = PlaneNormal(Origin=Point(0, 0, 0), ZAxis=vec_5)
rotate_2 = Rotate(Geometry=rotate.Geometry, Angle="2/3*Pi", Plane=pl)  # -> Geometry, Transform

# ----
unified_axis = Panel("""{0.0, 0.0, 1.0}
{0.356806, 0.0,  0.934179}
{0.0, 0.525734, 0.850649}""")
filter = StreamFilter(
    Gate=int,
    Stream0=geo_7,
    Stream1=geo_4,
    Stream2=geo_3,
    Stream3=geo_8,
    Stream4=geo_6,
    Stream5=geo,
    Stream6=geo_9,
    Stream7=geo_5,
    Stream8=geo_2,
    Stream9=geo_10)

# ---- group: 2
Z = UnitZ(Factor=1)

# ---- group: 3
vec_8 = Vector(vec_5)

# ---- group: projection to Z=1
expression_2 = Expression(v=unit_5, Expression="{v.x/v.z,v.y/v.z,1}")
expression_3 = Expression(v=rotate.Geometry, Expression="{v.x/v.z,v.y/v.z,1}")
expression_4 = Expression(v=rotate_2.Geometry, Expression="{v.x/v.z,v.y/v.z,1}")

# Gnomonic progection
expression_5 = Expression(v=unit_4, Expression="{v.x/v.z,v.y/v.z,1}")
expression_6 = Expression(v=unit_2, Expression="{v.x/v.z,v.y/v.z,1}")
expression_7 = Expression(v=unit_3, Expression="{v.x/v.z,v.y/v.z,1}")

# ----
# Align PDB
cluster = Cluster(_2fold_poly=Z, _3fold_poly=vec_8, axes_vir=unified_axis, vertices_vir=filter)

# ---- group: Mirror
yz = YZPlane(Origin=Point(0, 0, 0))
mirror = Mirror(Geometry=cluster, Plane=yz)  # -> Geometry, Transform

# ---- group: 2π/3 rotate
rot3d = Rotate3D(Geometry=cluster, Angle=degrees("120"), Center=Point(0, 0, 0), Axis=vec_8)  # -> Geometry, Transform

# ----
filter_2 = StreamFilter(Gate=rotate_mirror, Stream0=rot3d.Geometry, Stream1=mirror.Geometry)
filter_3 = StreamFilter(Gate=rotate_mirror, Stream0=cluster, Stream1=mirror.Geometry)

# ---- group: normalized radius of atoms
pdb_2 = Panel("""1vb4
2BUK
6s44
5zju
3r0r
1stm
7odw
4v7g
4v4m
1m1c""")
panel_3 = Panel("""1vb4: 73.62
2buk: 76.50
6s44: 72.42
5zju: 80.80
3r0r: 80.20
1stm: 68.08
7odw: 100.18
4v7g: Null
4v4m: 75.82
1m1c: 181.68
1m1c: 181.68
1m1c: 181.68""")
split = TextSplit(Text=panel_3, Separators=" ")
item = ListItem(List=split, Index="0", Wrap=True)  # -> Item, flatten(Item1)
radius_of_amino_acids = Panel("2.9475")
panel_4 = Panel(item.Item1)
division = Division(A=radius_of_amino_acids, B=panel_4)
normalized_radius_of_atoms = Panel(division)
item_2 = ListItem(List=normalized_radius_of_atoms, Index=int, Wrap=True)

# ----
filter_4 = StreamFilter(Gate=0, Stream0=filter_2, Stream1=filter_3)

# ---- group: hexagon along unit sphere
# Progection onto unit sphere
# Get gnomonic hexagon
merge = Merge(Data1=unit_5, Data2=unit_4, Data3=rotate.Geometry, Data4=unit_2, Data5=rotate_2.Geometry, Data6=unit_3)
# D1:Junction Point
# D2:2-fold axis
# D3:Copy around 2-fold axis
# D4:3-fold axis
# D5:Copy around 3-fold axis
# D6:5-fold axis
pline = PolyLine(Vertices=merge, Closed=invert(False))

# ---- group: gnomonical hexagon
merge_2 = Merge(Data1=expression_2, Data2=expression_5, Data3=expression_3, Data4=expression_6, Data5=expression_4, Data6=expression_7)
pline_2 = PolyLine(Vertices=merge_2, Closed=invert(False))

# ---- group: oriented PDB
geo_11 = Geometry(filter_4)

# ---- group: PDB
geo_12 = Geometry(geo_11)

# ---- group: gnomonic projection
expression_8 = Expression(v=geo_12, Expression="{v.x/v.z,v.y/v.z,1}")

# ---- group: voronoi tolerance debuging
# Get PDB voronoi region
pt_2 = Point(expression_8)
pt_3 = Point(Point(0, 0, 0))
geo_13 = Geometry(pt_2)
multiplication = Multiplication(A=item_2, B="1000")
scale = Scale(Geometry=geo_13, Center=pt_3, Factor="1000")  # -> Geometry, Transform
division_2 = Division(A="1", B="1000")
voronoi = Voronoi(Points=scale.Geometry, Radius=multiplication, BruteForceOverride=False)
scale_2 = Scale(Geometry=voronoi, Center=pt_3, Factor=division_2)  # -> Geometry, Transform

# ---- group: Polyline convert to orthodrome of unit sphere
# Tessellated onto unit sphere
explode = Explode(Curve=pline, Recursive=True)  # -> Segments, Vertices
cull_i = CullIndex(List=explode.Vertices, Indices="-1", Wrap=True)
shift = ShiftList(List=cull_i, Shift="1", Wrap=True)
ln = Line(StartPoint=cull_i, EndPoint=shift)
midpt = CurveMiddle(Curve=ln)
sph = Sphere(Base=PlaneXY(0, 0, 0), Radius="1")
end = EndPoints(Curve=ln)  # -> Start, End
srf_cp = SurfaceClosestPoint(Point=midpt, Surface=sph)  # -> Point, UVPoint, Distance
arc = Arc3Pt(PointA=end.Start, PointB=srf_cp.Point, PointC=end.End)  # -> Arc, Plane, Radius

# ---- group: 60 fold symmetry matrix
panel_5 = Panel("""1
0
0
0
0
1
0
0
0
0
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""")
partition = PartitionList(List=panel_5, Size="16")
matrix = ConstructMatrix(Rows="4", Columns="4", Values=partition)

# ----
explode_2 = Explode(Curve=scale_2.Geometry, Recursive=True)  # -> flatten(Segments), Vertices

# ---- group: evaluate boundary curve
line = Line(explode_2.Segments)

# ----
null = NullItem(Item=line)  # -> NullFlags, InvalidFlags, Description
dispatch = Dispatch(List=explode_2.Segments, DispatchPattern=null.NullFlags)  # -> ListA, ListB
join = JoinCurves(Curves=dispatch.ListA, Preserve=False)
geo_14 = Geometry(arc.Arc)

# ---- group: gnomonic hexagon
geo_15 = Geometry(pline_2)

# ----
transform = Transform(Geometry=geo_14, Transform=matrix)

# ---- group: Extract boundary
len = Length(Curve=join)
sort = SortList(Keys=len, ValuesA=join)  # -> Keys, ValuesA
rev = ReverseList(List=sort.ValuesA)
item_3 = ListItem(List=rev, Index=0, Wrap=True)  # -> Item, Item1

# ----
int_2 = Integer(rotate_mirror)
geo_16 = Geometry(geo_15)
equals = Equality(FirstNumber=pdb_id, SecondNumber="9")  # -> Equality, Inequality
yz_2 = YZPlane(Origin=Point(0, 0, 0))
mirror_2 = Mirror(Geometry=geo_16, Plane=yz_2)  # -> Geometry, Transform
mirror_3 = Mirror(Geometry=item_3.Item, Plane=yz_2)  # -> Geometry, Transform

# ---- group: Dihedron region :Gnomonic hexagon
filter_5 = StreamFilter(Gate=int_2, Stream0=geo_16, Stream1=mirror_2.Geometry)

# ---- group: PDB region: Voronoi boundary
# Get Region intersection
filter_6 = StreamFilter(Gate=int_2, Stream0=item_3.Item, Stream1=mirror_3.Geometry)

# ---- group: intersection tolerance debuging
scale_3 = Scale(Geometry=filter_5, Center=Point(0, 0, 0), Factor="50")  # -> Geometry, Transform
scale_4 = Scale(Geometry=filter_6, Center=Point(0, 0, 0), Factor="50")  # -> Geometry, Transform
division_3 = Division(A="1", B="50")
rint = RegionIntersection(CurvesA=filter_6, CurvesB=filter_5)
rint_2 = RegionIntersection(CurvesA=scale_3.Geometry, CurvesB=scale_4.Geometry)
scale_5 = Scale(Geometry=rint_2, Center=Point(0, 0, 0), Factor=division_3)  # -> Geometry, Transform

# ---- group: intersection tolerance debuging / Voronoi∩Gnomonic
filter_7 = StreamFilter(Gate=equals.Equality, Stream0=scale_5.Geometry, Stream1=rint)

# ---- group: B
area = Area(Geometry=filter_6)  # -> Area, Centroid
item_4 = ListItem(List=area.Area, Index=0, Wrap=True)  # -> Item, Item1

# ---- group: A∩B
area_2 = Area(Geometry=filter_7)  # -> Area, Centroid

# ---- group: A
area_3 = Area(Geometry=filter_5)  # -> Area, Centroid

# ----
division_4 = Division(A=area_2.Area, B=area_3.Area)
division_5 = Division(A=area_2.Area, B=item_4.Item1)
a_b_a = Panel(division_4)
a_b_b = Panel(division_5)
boundary = BoundarySurfaces(Edges=pline_2)

# ---- group: exclude the case "gnomonic hexagon" dont have 6 edges
explode_3 = Explode(Curve=geo_15, Recursive=True)  # -> Segments, Vertices
lng = ListLength(List=explode_3.Segments)
expression_9 = Expression(x=lng, a="1000000", Expression="If(x=6, 0, a)")

# ---- group: 1-"Dice parameter"
expression_10 = Expression(x=area_3.Area, y=item_4.Item1, z=area_2.Area, Expression="1-(2*z)/(x+y)")

# ---- group: exclude the case the boundary splited over 2
# Set goal function
lng_2 = ListLength(List=boundary)
expression_11 = Expression(x=lng_2, a="1000000", Expression="If(x>1, a, 0)")

# ---- group: penalized if the area cannnot be calculated
nullrep = ReplaceNulls(Items=expression_10, Replacements=Slider(100000, range=0..100000))  # -> Items, Count

# ---- group: goal function value
addition = Addition(A=expression_11, B=expression_9, D=nullrep.Items)

# ----
sort_2 = SortList(Keys=addition, ValuesA=addition)  # -> Keys, ValuesA
item_5 = ListItem(List=sort_2.ValuesA, Index=0, Wrap=True)
panel_6 = Panel(item_5)

# ---- group: Junction point
pt_4 = Point(expression)

# ---- group: gnomonic hexagon
geo_17 = Geometry(pline_2)

# ---- group: 2-symmetric
# Visualization
vec_9 = Vector(vec_6)

# ---- group: 3-symmetric
vec_10 = Vector(vec_5)

# ---- group: 5-symmetric
vec_11 = Vector(vec_7)

# ---- group: spherical triangle {235}
merge_3 = Merge(Data1=vec_9, Data2=vec_10, Data3=vec_11)

# ---- group: gnomonic triangle 235
# Unit shape at gnomonic plane
expression_12 = Expression(v=merge_3, Expression="{v.x/v.z,v.y/v.z,1}")
pline_3 = PolyLine(Vertices=expression_12, Closed=invert(False))

# ---- group: generate cutting line (dotted)
number_slider = Slider(8, range=0..10)
ln_2 = Line(StartPoint=expression_12, EndPoint=pt_4)
len_2 = Length(Curve=ln_2)
item_6 = ListItem(List=len_2, Index=0, Wrap=True)  # -> Item, Item1, Item2
division_6 = Division(A=item_6.Item2, B=item_6.Item)
division_7 = Division(A=item_6.Item1, B=item_6.Item)
multiplication_2 = Multiplication(A=number_slider, B=division_6)
multiplication_3 = Multiplication(A=number_slider, B=division_7)
merge_4 = Merge(Data1=number_slider, Data2=multiplication_3, Data3=multiplication_2)
divide = DivideCurve(Curve=ln_2, Count=merge_4, Kinks=False)  # -> Points, Tangents, Parameters
curveshatter = CurveShatter(Curve=graft(ln_2), Points=divide.Points, Tolerance=0.01)
dispatch_2 = Dispatch(List=curveshatter, DispatchPattern=[True, False])  # -> ListA, ListB
geo_18 = Geometry(dispatch_2.ListA)

# ---- group: 1m1c
# MultiPipe
pt_5 = Point(Point(0.047, -0.122, 1))

# ---- group: 4v4m
pt_6 = Point(Point(0.209, -0.254, 1))

# ---- group: 1stm
pt_7 = Point(Point(0.249, 0.001, 1))

# ---- group: 4v7g
pt_8 = Point(Point(0.092, 0.106, 1))

# ---- group: 7odw
pt_9 = Point(Point(-0.011, 0.157, 1))

# ---- group: 1vb4
pt_10 = Point(Point(0.143, 0.031, 1))

# ---- group: 6s44
pt_11 = Point(Point(0.038, 0.218, 1))

# ---- group: 3r0r
pt_12 = Point(Point(0.197, -0.068, 1))

# ---- group: 5zju
pt_13 = Point(Point(-0.163, 0.033, 1))

# ---- group: 2buk
pt_14 = Point(Point(0.065, 0.236, 1))

# ----
# All capsid plot
plotting_text = Panel("""1vb4
2buk
6s44
5zju
3r0r
1stm
7odw
4v7g
4v4m
1m1c""")
number_slider_2 = Slider(0.01, range=0..5)
number_slider_3 = Slider(0.007, range=0.001..0.01)
merge_5 = Merge(
    Data1=pt_10,
    Data2=pt_14,
    Data3=pt_11,
    Data4=pt_13,
    Data5=pt_12,
    Data6=pt_7,
    Data7=pt_9,
    Data8=pt_8,
    Data9=pt_6,
    Data10=pt_5)

# ---- group: Multi Pipe / 60fold symmetry matrix
panel_7 = Panel("""1
0
0
0
0
1
0
0
0
0
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""")
partition_2 = PartitionList(List=panel_7, Size="16")
matrix_2 = ConstructMatrix(Rows="4", Columns="4", Values=partition_2)

# ---- group: Multi Pipe
pline_4 = PolyLine(Vertices=geo_11, Closed=False)
mp = MultiPipe(Curves=pline_4, NodeSize=item_2, EndOffset=1, StrutSize=1, Segment=0, KinkAngle=0.6, CubeFit=0, Caps="1")
dam = DataDam(DataA=mp, BufferDelay=20000000, BufferMode=2)
preview = CustomPreview(
    Geometry=mp,
    Material={diffuse=RGB(221, 160, 221), emission=RGB(66, 48, 66), shine=0.5, specular=RGB(255, 255, 255), transparency=0})
transform_2 = Transform(Geometry=dam, Transform=matrix_2)  # -> flatten(Geometry)
pt_15 = Point(Point(240, 240, 240))
material = CreateMaterial(Diffuse=pt_15, Specular=RGB(255, 255, 255), Emission=RGB(0, 0, 0), Transparency=0, Shine=0)
preview_2 = CustomPreview(
    Geometry=transform_2,
    Material={diffuse=RGB(221, 160, 221), emission=RGB(66, 48, 66), shine=0.5, specular=RGB(255, 255, 255), transparency=0})

# ---- group: 文字と点が重ならないようにする
neg = Negative(Value=Slider(0.0088, range=0..0.2))
vec_12 = VectorXYZ(XComponent=neg, YComponent=Slider(0.0181, range=0..0.2), ZComponent=0)  # -> Vector, Length
move = Move(Geometry=merge_5, Motion=vec_12.Vector)  # -> Geometry, Transform

# ----
cir = Circle(Plane=merge_5, Radius=number_slider_3)
boundary_2 = BoundarySurfaces(Edges=cir)

number_slider_4 = Slider(1, range=0..1)
cmyk = ColourCMYK(Cyan=Slider(0, range=0..1), Magenta=Slider(1, range=0..1), Yellow=Slider(1, range=0..1), Key=Slider(0.27, range=0..1))
cmyk_2 = ColourCMYK(Cyan=Slider(0, range=0..1), Magenta=number_slider_4, Yellow=number_slider_4, Key=Slider(1, range=0..1))
cmyk_3 = ColourCMYK(
    Cyan=Slider(1, range=0..1),
    Magenta=Slider(0.68, range=0..1),
    Yellow=Slider(0.13, range=0..1),
    Key=Slider(0.24, range=0..1))

# ---- group: 文字の色、大きさ
number_slider_5 = Slider(3.23, range=0..10)
number_slider_6 = Slider(1, range=0..1)
cmyk_4 = ColourCMYK(Cyan=number_slider_6, Magenta=number_slider_6, Yellow=number_slider_6, Key=Slider(0.8, range=0..1))
tag = TextTag3D(Location=move.Geometry, Text=plotting_text, Size=Slider(0.02, range=0.001..0.1), Colour=cmyk_4, Justification=5)

# ----
cloud = CloudDisplay(Points=merge_5, Colours=cmyk_4, Size=number_slider_3, SpriteType=1)

# ---- group: 235三角形
pline_5 = PolyLine(Vertices=expression_12, Closed=invert(False))

# ----
number_slider_7 = Slider(1, range=0..1)
cmyk_5 = ColourCMYK(Cyan=number_slider_7, Magenta=number_slider_7, Yellow=number_slider_7, Key=Slider(0.8, range=0..1))
previewlw = CustomPreviewLineweights(Geometry=pline_5, Shader=cmyk_5, Thickness=Slider(2, range=0..10), Absolute=False)

# ---- group: cutting line
previewlw_2 = CustomPreviewLineweights(Geometry=geo_18, Shader=cmyk_2, Thickness=Slider(0.99, range=0..2), Absolute=False)

# ---- group: gnomonic triangle
previewlw_3 = CustomPreviewLineweights(Geometry=pline_3, Shader=cmyk_3, Thickness=Slider(3, range=0..10), Absolute=False)

# ---- group: junction point
cloud_2 = CloudDisplay(Points=pt_4, Colours=cmyk, Size=Slider(0.01, range=0..5), SpriteType=1)

# ---- group: gnomonic hexagon
previewlw_4 = CustomPreviewLineweights(Geometry=geo_17, Shader=cmyk, Thickness=Slider(5.06, range=0..9), Absolute=False)

# ---- group: generate multipipe / rot or mirror
int_3 = Integer(rotate_mirror)

# ----
panel_8 = Panel("""Humanのテキストはdisplay上のピクセル座標を入力する必要あり
→point3dから抽出できないか？""")

# ---- group: all units
geo_19 = Geometry(transform)

# ---- group: spherical hexagon
# Tessellated on unit sphere
geo_20 = Geometry(geo_14)

# ---- group: selected PDB ID
int_4 = Integer(rotate_mirror)

# ----
duppt = RemoveDuplicatePts(Tolerance=0.01)

yz_3 = YZPlane(Origin=Point(0, 0, 0))
mirror_4 = Mirror(Geometry=geo_20, Plane=yz_3)  # -> Geometry, Transform
item_7 = ListItem(List=int_4, Index=pdb_id, Wrap=True)
yz_4 = YZPlane(Origin=Point(0, 0, 0))
mirror_5 = Mirror(Geometry=geo_19, Plane=yz_4)  # -> Geometry, Transform
filter_8 = StreamFilter(Gate=item_7, Stream0=geo_19, Stream1=mirror_5.Geometry)
filter_9 = StreamFilter(Gate=item_7, Stream0=geo_20, Stream1=mirror_4.Geometry)

number_slider_8 = Slider(0, range=0..1)
number_slider_9 = Slider(0, range=0..1)
sph_2 = Sphere(Base=PlaneXY(0, 0, 0), Radius=1)
geo_21 = Geometry(sph_2)
cmyk_6 = ColourCMYK(Cyan=Slider(0, range=0..1), Magenta=Slider(1, range=0..1), Yellow=Slider(1, range=0..1), Key=Slider(0.27, range=0..1))
cmyk_7 = ColourCMYK(Cyan=number_slider_8, Magenta=number_slider_8, Yellow=number_slider_8, Key=Slider(0.09, range=0..1))
cmyk_8 = ColourCMYK(Cyan=number_slider_9, Magenta=number_slider_9, Yellow=number_slider_9, Key=Slider(0.8, range=0..1))
scale_6 = Scale(Geometry=geo_21, Center=Point(0, 0, 0), Factor=Slider(0.99, range=0..1))  # -> Geometry, Transform

# ---- group: Represent unit
previewlw_5 = CustomPreviewLineweights(Geometry=filter_9, Shader=cmyk_6, Thickness=Slider(5.06, range=0..9), Absolute=False)

# ---- group: all units
previewlw_6 = CustomPreviewLineweights(Geometry=filter_8, Shader=cmyk_8, Thickness=Slider(2, range=0..2), Absolute=False)

# ---- group: unit sphere
preview_3 = CustomPreview(Geometry=scale_6.Geometry, Material=cmyk_7)

# ---- group: generate multipipe
cull_i_2 = CullIndex(List=transform_2, Indices="0", Wrap=True)
item_8 = ListItem(List=transform_2, Index="0", Wrap=True)
yz_5 = YZPlane(Origin=Point(0, 0, 0))
yz_6 = YZPlane(Origin=Point(0, 0, 0))

# ---- group: generate multipipe / 59
geo_22 = Geometry(cull_i_2)

# ---- group: generate multipipe / Unit
geo_23 = Geometry(item_8)

# ---- group: generate multipipe (continued)
mirror_6 = Mirror(Geometry=geo_22, Plane=yz_5)  # -> Geometry, Transform
mirror_7 = Mirror(Geometry=geo_23, Plane=yz_6)  # -> Geometry, Transform
filter_10 = StreamFilter(Gate=int_3, Stream0=geo_22, Stream1=mirror_6.Geometry)
filter_11 = StreamFilter(Gate=int_3, Stream0=geo_23, Stream1=mirror_7.Geometry)

# ---- group: generate multipipe / left: 59
geo_24 = Geometry(filter_10)

# ---- group: generate multipipe / oriented a unit
geo_25 = Geometry(filter_11)

# ==== cluster Cluster
axes_vir = ClusterInput()
vertices_vir = ClusterInput()
_3fold_poly = ClusterInput()
_2fold_poly = ClusterInput()
item = ListItem(List=axes_vir, Index=0, Wrap=True)  # -> Item, Item1
pl = ConstructPlane(Origin=Point(0, 0, 0), XAxis=item.Item, YAxis=item.Item1)
pl_2 = ConstructPlane(Origin=Point(0, 0, 0), XAxis=_2fold_poly, YAxis=_3fold_poly)
orient = Orient(Geometry=vertices_vir, Source=pl, Target=pl_2)  # -> Geometry, Transform
G = ClusterOutput(orient.Geometry)
